# Grasshopper definition networkAnalysis.gh (Grasshopper 1.0.7)
# plug-ins: UrbanXTools

# ----
# 设计地块
curve = Curve([<curve referenced from the Rhino model> x527])

# ----
# 设计路网
curve_2 = Curve([<curve referenced from the Rhino model> x88])

# ----
# 路网密度计算范围
curve_3 = Curve(<curve referenced from the Rhino model>)

# ----
# 路网可达性
na_clearroadsdata = NA_ClearRoadsData(OriginalRoadsData=curve_2)
na_computing = NA_Computing(Roads=na_clearroadsdata, Radius=Slider(10000, range=0..10000), Normalise=Toggle(True))  # -> Metric_Betweenness, Metric_Closeness, Angular_Betweenness, Angular_Closeness
data = Data(na_computing.Metric_Betweenness)
display = Display(parameter=data)
custom_preview = CustomPreview(Geometry=na_clearroadsdata, Material=display)
curve_middle = CurveMiddle(Curve=na_clearroadsdata)
text_tag_3d = TextTag3D(Location=curve_middle, Text=data, Size=30, Justification=7)

# ----
# 地块可达性
na_clearsitesdata = NA_ClearSitesData(OriginalSitesData=curve)
na_siteaccessibility = NA_SiteAccessibility(RoadsSegments=na_clearroadsdata, RoadsScores=data, SitesCurves=na_clearsitesdata)  # -> SitesPolygons, SiteScores
display_2 = Display(parameter=na_siteaccessibility.SiteScores)
boundary_surfaces = BoundarySurfaces(Edges=na_siteaccessibility.SitesPolygons)
custom_preview_2 = CustomPreview(Geometry=boundary_surfaces, Material=display_2)

na_roaddensity = NA_RoadDensity(Roads=curve_2, Boundary=curve_3)  # -> RoadDensityDouble, RoadDensityString, CurvesInBoundary
panel = Panel(na_roaddensity.RoadDensityString)

# ==== cluster Display
parameter = ClusterInput()
bounds = Bounds(Numbers=parameter)
deconstruct_domain = DeconstructDomain(Domain=bounds)  # -> Start, End
gradient = Gradient(
    LowerLimit=deconstruct_domain.Start,
    UpperLimit=deconstruct_domain.End,
    Parameter=parameter,
    stops=[0: RGB(0, 128, 0), 0.528: RGB(255, 255, 0), 1: RGB(255, 0, 0)])
colour = ClusterOutput(gradient)
